% Simulink data dictionary environmentData.sldd

envCatalog = [struct(
  Name="Sea Level Standard",
  Description="ISA sea level, zero wind — reference baseline for all teams",
  Multiplier=1,
  CompetitionSite=false,
  Location=struct(
    Name="ISA Reference Datum",
    City="Sea Level",
    Country="",
    Latitude_deg=0,
    Longitude_deg=0,
    Elevation_MSL_m=0),
  Atmosphere=struct(
    Elevation_MSL_m=0,
    ISA_Deviation_C=0,
    Temperature_C=15,
    Pressure_Pa=101325,
    Density_kgm3=1.225,
    DensityRatio=1),
  WindShear=struct(Speed_6m_mps=0, Direction_deg=0, Exponent=0.143),
  Turbulence=struct(
    Speed_6m_mps=0,
    Direction_deg=0,
    Sigma_mps=0,
    Scale_Lu_m=205,
    TurbulenceOn=false,
    NoiseSeeds=[23341 23342 23343 23344]),
  Gust=struct(
    Amplitude_mps=[0 0 0],
    Length_m=[1 1 1],
    StartTime_s=Inf,
    StartAltitude_AGL_m=0,
    EnableU=false,
    EnableV=false,
    EnableW=false),
  Latitude_deg=0,
  Longitude_deg=0,
  Elevation_MSL_m=0), struct(
  Name="Competition Day — West (Van Nuys CA, April)",
  Description="Apollo XI RC Field, Van Nuys CA — SAE Aero Design West, April avg",
  Multiplier=1.1,
  CompetitionSite=true,
  Location=struct(
    Name="Apollo XI RC Field — SAE Aero Design West",
    City="Van Nuys",
    Country="CA USA",
    Latitude_deg=34.1809,
    Longitude_deg=-118.4835,
    Elevation_MSL_m=239),
  Atmosphere=struct(
    Elevation_MSL_m=239,
    ISA_Deviation_C=6,
    Temperature_C=19.4,
    Pressure_Pa=98487,
    Density_kgm3=1.1726,
    DensityRatio=0.9572245),
  WindShear=struct(Speed_6m_mps=4.5, Direction_deg=200, Exponent=0.143),
  Turbulence=struct(
    Speed_6m_mps=4.5,
    Direction_deg=200,
    Sigma_mps=1.06,
    Scale_Lu_m=205,
    TurbulenceOn=false,
    NoiseSeeds=[23341 23342 23343 23344]),
  Gust=struct(
    Amplitude_mps=[0 0 0],
    Length_m=[1 1 1],
    StartTime_s=Inf,
    StartAltitude_AGL_m=0,
    EnableU=false,
    EnableV=false,
    EnableW=false),
  Latitude_deg=34.1809,
  Longitude_deg=-118.4835,
  Elevation_MSL_m=239), struct(
  Name="Competition Day — East FL (Lakeland, March)",
  Description="KLAL Lakeland FL — SAE Aero Design East, March avg (2024, 2026 venue)",
  Multiplier=1.2,
  CompetitionSite=true,
  Location=struct(
    Name="Lakeland Linder Intl Airport (KLAL)",
    City="Lakeland",
    Country="FL USA",
    Latitude_deg=27.9889,
    Longitude_deg=-81.9478,
    Elevation_MSL_m=43.3),
  Atmosphere=struct(
    Elevation_MSL_m=43.3,
    ISA_Deviation_C=7,
    Temperature_C=22,
    Pressure_Pa=100806,
    Density_kgm3=1.191,
    DensityRatio=0.9722449),
  WindShear=struct(Speed_6m_mps=5.9, Direction_deg=120, Exponent=0.143),
  Turbulence=struct(
    Speed_6m_mps=5.9,
    Direction_deg=120,
    Sigma_mps=1.06,
    Scale_Lu_m=205,
    TurbulenceOn=false,
    NoiseSeeds=[23341 23342 23343 23344]),
  Gust=struct(
    Amplitude_mps=[0 0 0],
    Length_m=[1 1 1],
    StartTime_s=Inf,
    StartAltitude_AGL_m=0,
    EnableU=false,
    EnableV=false,
    EnableW=false),
  Latitude_deg=27.9889,
  Longitude_deg=-81.9478,
  Elevation_MSL_m=43.3), struct(
  Name="Competition Day — East TX (Fort Worth, May)",
  Description="Thunderbird Field, Fort Worth TX — SAE Aero Design East, May avg (2025 venue)",
  Multiplier=1.3,
  CompetitionSite=true,
  Location=struct(
    Name="Thunderbird Field, Mustang Park (SAE Aero Design East)",
    City="Fort Worth",
    Country="TX USA",
    Latitude_deg=32.5292,
    Longitude_deg=-97.4797,
    Elevation_MSL_m=262),
  Atmosphere=struct(
    Elevation_MSL_m=262,
    ISA_Deviation_C=12,
    Temperature_C=25.3,
    Pressure_Pa=98217,
    Density_kgm3=1.1465,
    DensityRatio=0.9359184),
  WindShear=struct(Speed_6m_mps=4.6, Direction_deg=160, Exponent=0.143),
  Turbulence=struct(
    Speed_6m_mps=4.6,
    Direction_deg=160,
    Sigma_mps=1.06,
    Scale_Lu_m=205,
    TurbulenceOn=false,
    NoiseSeeds=[23341 23342 23343 23344]),
  Gust=struct(
    Amplitude_mps=[0 0 0],
    Length_m=[1 1 1],
    StartTime_s=Inf,
    StartAltitude_AGL_m=0,
    EnableU=false,
    EnableV=false,
    EnableW=false),
  Latitude_deg=32.5292,
  Longitude_deg=-97.4797,
  Elevation_MSL_m=262), struct(
  Name="Hot Day (Chennai India, March)",
  Description="VOMM Chennai India, March avg — hot thin air, reduced thrust and lift",
  Multiplier=1.5,
  CompetitionSite=false,
  Location=struct(
    Name="Chennai Intl Airport (VOMM)",
    City="Chennai",
    Country="Tamil Nadu, India",
    Latitude_deg=12.9941,
    Longitude_deg=80.1709,
    Elevation_MSL_m=16),
  Atmosphere=struct(
    Elevation_MSL_m=16,
    ISA_Deviation_C=15,
    Temperature_C=30,
    Pressure_Pa=101133,
    Density_kgm3=1.1626,
    DensityRatio=0.9490612),
  WindShear=struct(Speed_6m_mps=3.5, Direction_deg=230, Exponent=0.143),
  Turbulence=struct(
    Speed_6m_mps=3.5,
    Direction_deg=230,
    Sigma_mps=1.06,
    Scale_Lu_m=205,
    TurbulenceOn=false,
    NoiseSeeds=[23341 23342 23343 23344]),
  Gust=struct(
    Amplitude_mps=[0 0 0],
    Length_m=[1 1 1],
    StartTime_s=Inf,
    StartAltitude_AGL_m=0,
    EnableU=false,
    EnableV=false,
    EnableW=false),
  Latitude_deg=12.9941,
  Longitude_deg=80.1709,
  Elevation_MSL_m=16), struct(
  Name="Cold Windy Day (Toronto ON, March)",
  Description="CYYZ Toronto Canada, March avg — cold dense air, strong gusty NW wind",
  Multiplier=1.6,
  CompetitionSite=false,
  Location=struct(
    Name="Toronto Pearson Intl Airport (CYYZ)",
    City="Toronto",
    Country="ON Canada",
    Latitude_deg=43.6772,
    Longitude_deg=-79.6306,
    Elevation_MSL_m=173),
  Atmosphere=struct(
    Elevation_MSL_m=173,
    ISA_Deviation_C=-14,
    Temperature_C=1,
    Pressure_Pa=99264,
    Density_kgm3=1.2666,
    DensityRatio=1.033959),
  WindShear=struct(Speed_6m_mps=7.8, Direction_deg=315, Exponent=0.16),
  Turbulence=struct(
    Speed_6m_mps=7.8,
    Direction_deg=315,
    Sigma_mps=2.12,
    Scale_Lu_m=205,
    TurbulenceOn=true,
    NoiseSeeds=[23341 23342 23343 23344]),
  Gust=struct(
    Amplitude_mps=[-2.828427 2.828427 0],
    Length_m=[150 150 150],
    StartTime_s=45,
    StartAltitude_AGL_m=20,
    EnableU=true,
    EnableV=true,
    EnableW=false),
  Latitude_deg=43.6772,
  Longitude_deg=-79.6306,
  Elevation_MSL_m=173), struct(
  Name="Afternoon Gusts (Lakeland FL)",
  Description="KLAL Lakeland FL afternoon — SW wind shift, crosswind gust on approach",
  Multiplier=2,
  CompetitionSite=false,
  Location=struct(
    Name="Lakeland Linder Intl Airport (KLAL)",
    City="Lakeland",
    Country="FL USA",
    Latitude_deg=27.9889,
    Longitude_deg=-81.9478,
    Elevation_MSL_m=43.3),
  Atmosphere=struct(
    Elevation_MSL_m=43.3,
    ISA_Deviation_C=13,
    Temperature_C=28,
    Pressure_Pa=100806,
    Density_kgm3=1.1672,
    DensityRatio=0.9528163),
  WindShear=struct(Speed_6m_mps=8, Direction_deg=220, Exponent=0.143),
  Turbulence=struct(
    Speed_6m_mps=8,
    Direction_deg=220,
    Sigma_mps=2.12,
    Scale_Lu_m=205,
    TurbulenceOn=true,
    NoiseSeeds=[23341 23342 23343 23344]),
  Gust=struct(
    Amplitude_mps=[0 4 0],
    Length_m=[1 200 1],
    StartTime_s=90,
    StartAltitude_AGL_m=15,
    EnableU=false,
    EnableV=true,
    EnableW=false),
  Latitude_deg=27.9889,
  Longitude_deg=-81.9478,
  Elevation_MSL_m=43.3), struct(
  Name="High Density Altitude (Denver-type)",
  Description="Denver-type 1600m ISA+10 — 82.5% sea-level density, hardest thrust/lift case",
  Multiplier=2.5,
  CompetitionSite=false,
  Location=struct(
    Name="High Altitude Reference (KDEN-type)",
    City="Denver",
    Country="CO USA",
    Latitude_deg=39.8561,
    Longitude_deg=-104.6737,
    Elevation_MSL_m=1600),
  Atmosphere=struct(
    Elevation_MSL_m=1600,
    ISA_Deviation_C=10,
    Temperature_C=14.6,
    Pressure_Pa=83523,
    Density_kgm3=1.0112,
    DensityRatio=0.8254694),
  WindShear=struct(Speed_6m_mps=5, Direction_deg=270, Exponent=0.143),
  Turbulence=struct(
    Speed_6m_mps=5,
    Direction_deg=270,
    Sigma_mps=1.06,
    Scale_Lu_m=205,
    TurbulenceOn=false,
    NoiseSeeds=[23341 23342 23343 23344]),
  Gust=struct(
    Amplitude_mps=[0 0 0],
    Length_m=[1 1 1],
    StartTime_s=Inf,
    StartAltitude_AGL_m=0,
    EnableU=false,
    EnableV=false,
    EnableW=false),
  Latitude_deg=39.8561,
  Longitude_deg=-104.6737,
  Elevation_MSL_m=1600)]

envPreset = 1